# Dynamo graph BIMACON_Pisos acompanhando Topografia_RVT 2024_R00_script.dyn (Dynamo 2.19.3.6394)
# packages: Data-Shapes 2022.2.105, Orchid 2.19.3.6373

# group: Input
n02_selecione_o_piso = DSModelElementSelection()  # "02 - Selecione o Piso"; 1 picked in the model; graph input
n01_selecione_a_sub_região = DSModelElementSelection()  # "01 - Selecione a Sub-Região"; 1 picked in the model; graph input
n03_offset = DoubleInput(0.2)  # "03 - Offset"

# group: ENTRADAS PARA O USUÁRIO
code_block = CodeBlock()  # //Data-Shapes
code_block_2 = CodeBlock()  # //archilab
code_block_3 = CodeBlock { "Ajuste do Piso à Superfície Topográfica"; }
file_path = Filename("..\..\..\..\..\05 - BIMACON\01 - EMPRESA BIMACON\00 - Logos e imagens - BIMACON\ARTE BIMACON\reddonda-removebg-preview.png")
file_from_path = FileObject(path=file_path)
readFromFile = Image.ReadFromFile(file=file_from_path)
string = StringInput("Confirmar")
string_2 = StringInput("Subregião (deverá ter o mesmo contorno do piso)")
string_3 = StringInput("Selecione ")
categories = Categories("OST_BuildingPad")
categories_2 = Categories("OST_Topography")
categories_3 = Categories("OST_Toposolid")
list_create = List.Create(item0=categories, item1=categories_2, item2=categories_3)
boolean = BoolSelector(true)
selectmodelelements_data = Custom[SelectModelElements Data](InputName=string_2, ButtonText=string_3, CategoryFilter=list_create, SelectSingleElement=boolean)  # package Data-Shapes; Creates a Revit element selection input for UI.MultipleInputForm++ . Check out www.data-shapes.net for more infos!
string_4 = StringInput("Piso à ser ajustado")
categories_4 = Categories("OST_Floors")
selectmodelelements_data_2 = Custom[SelectModelElements Data](InputName=string_4, ButtonText=string_3, CategoryFilter=categories_4, SelectSingleElement=boolean)
string_5 = StringInput("Offset do piso em relação à topografia")
string_6 = StringInput("0")
boolean_2 = BoolSelector(true)
textbox_data = Custom[TextBox Data](InputName=string_5, DefaultText=string_6, IsNumberEntry=boolean_2)  # package Data-Shapes; Create Data for TextBox input in UI.MultipleInputForm ++ . Check out www.data-shapes.net for more informations
list_create_2 = List.Create(item0=selectmodelelements_data, item1=selectmodelelements_data_2, item2=textbox_data)
boolean_3 = BoolSelector(true)
string_7 = StringInput("Cancelar")
number = DoubleInput(600)
number_2 = DoubleInput(190)
multipleinputform = Custom[MultipleInputForm ++](Description_optional=code_block_3, Logo_optional=readFromFile, ButtonText_optional=string, Inputs=list_create_2, Toggle=boolean_3, CancelButtonText_optional=string_7, Width_optional=number, LabelWidth_optional=number_2)  # package Data-Shapes; Create a form with multiple inputs. see www.data-shapes.net for tutorials and infos!

# group: Separar Entradas
code_block_4 = CodeBlock { 1; }
getItemAtIndex = List.GetItemAtIndex(list=multipleinputform.User_Inputs, index=code_block_4)
code_block_5 = CodeBlock { 0; }
getItemAtIndex_2 = List.GetItemAtIndex(list=multipleinputform.User_Inputs, index=code_block_5)
code_block_6 = CodeBlock { 2; }
getItemAtIndex_3 = List.GetItemAtIndex(list=multipleinputform.User_Inputs, index=code_block_6)

# group: Obter os pontos da Subregião sólida
faces = Element.Faces(element=getItemAtIndex_2)
perimeterCurves = Surface.PerimeterCurves(surface=faces)
intersect = Geometry.Intersect(geometry=perimeterCurves, other=perimeterCurves, lacing=CrossProduct)
flatten = List.Flatten(list=intersect)
code_block_7 = CodeBlock { "Autodesk.DesignScript.Geometry.Point"; }
removeIfNot = List.RemoveIfNot(list=flatten, type=code_block_7)
pruneDuplicates = Point.PruneDuplicates(points=removeIfNot)

# group: Agrupar pontos coincidentes com alturas diferentes
X = Point.X(point=pruneDuplicates)
code_block_8 = CodeBlock { 2; }
round = Math.Round(number=X, digits=code_block_8)
groupByKey = List.GroupByKey(list=pruneDuplicates@L2, keys=round@L2)

# group: Obter apenas os pontos inferiores
Z = Point.Z(point=groupByKey.groups)
sortByKey = List.SortByKey(list=groupByKey.groups@L2, keys=Z@L2)
firstItem = List.FirstItem(list=sortByKey.sortedList@L2)  # frozen

# group: Inserir o Offset para o Piso
X_2 = Point.X(point=firstItem)
Y = Point.Y(point=firstItem)
Z_2 = Point.Z(point=firstItem)
add = Z_2 + getItemAtIndex_3
byCoordinates = Point.ByCoordinates(x=X_2, y=Y, z=add)

# group: Inserir pontos no Piso
addPoint = Floor.AddPoint(floor=getItemAtIndex, point=byCoordinates)

# group: Mensagem Final
flatten_2 = List.Flatten(list=addPoint)
count = List.Count(list=flatten_2)
code_block_9 = CodeBlock { 0; }
gt = count > code_block_9
code_block_10 = CodeBlock { ["Feito! você anexou o piso junto a topografia"]; }
code_block_11 = CodeBlock { ["Nenhum Piso foi anexado a topografia"]; }
if_ = If(test=gt, true=code_block_10, false=code_block_11)
flatten_3 = List.Flatten(list=if_)
fromList = Orchid.Common.String.FromList(list=flatten_3)
python_script = Python(IN[0]=fromList)  # IronPython2
# ---------- python_script.python (21 lines) ----------
# Importar as bibliotecas necessárias do Revit
import clr
clr.AddReference("RevitServices")
from RevitServices.Persistence import DocumentManager

clr.AddReference("RevitAPI")
clr.AddReference("RevitAPIUI")
from Autodesk.Revit.UI import TaskDialog

# Pegar a entrada do Dynamo
mensagem = IN[0]

# Criar a TaskDialog
task_dialog = TaskDialog("Ok")
task_dialog.MainInstruction = mensagem

# Exibir a TaskDialog
task_dialog.Show()

# Saída do script
OUT = "Sucesso!"
# ----------------------------------------
